# Dynamo custom node ConnectPoints.dyf
# category: Create Geometry.Curve

refPts = Input()
len = Length(refPts)
number = DoubleInput(2)
lt = LessThan(len, number)
empty = Empty()
take = TakeList(number, refPts)
boolean = BoolSelector(true)
curve_by_points = CurveByPoints(take, boolean, lacing=Longest)
rest = Rest(refPts)
connectPoints = Custom[ConnectPoints](refPts=rest)
cons = List(curve_by_points, connectPoints)
if_ = Conditional(lt, empty, cons)
