# Dynamo graph Indexed Family Instances.dyn

number = DoubleInput(0)
number_2 = DoubleInput(1)
number_slider = DoubleSliderInput(25.01234568, range=10..90)
number_3 = DoubleInput(1)
number_sequence = BuildSeq(number_2, number_slider, number_3)
multiply = Multiplication(number, number_sequence, lacing=Longest)
XYZ = XYZ(number, number, multiply, lacing=Longest)
family_type_selector = FamilyTypeSelector(index=17, lacing=14)
create_fam_inst = FamilyInstanceCreatorXYZ(XYZ, family_type_selector, lacing=Longest)
string = StringInput("increment")
set_fam_inst_param = FamilyInstanceParameterSetter(create_fam_inst, string, number_sequence, lacing=Longest)
