# Dynamo graph tesselation with coincident grids.dyn

face_by_selection = FormElementBySelection()  # 1 picked in the model
surface_domain = SurfaceDomain(face_by_selection)
# note: Wiggle Sliders
# for Awesome
number_slider = DoubleSliderInput(11.27946128, range=0..20)
uv_grid = UVGrid(surface_domain, number_slider, number_slider)
evaluate_uv = XYZEvaluate(uv_grid, face_by_selection, lacing=Longest)
number_slider_2 = DoubleSliderInput(6.515151515, range=0..20)
uv_grid_2 = UVGrid(surface_domain, number_slider_2, number_slider_2)
append = Append(uv_grid_2, uv_grid)
delaunay_tessellation = DelaunayTessellation(append, face_by_selection)
list = NewList(item_s=evaluate_uv, index1=delaunay_tessellation)
watch_3d = Watch3D(list)
curve_by_points_by_line = CurveByPointsByLine()
