# Dynamo graph tesselation.dyn

select_face = FormElementBySelection()  # 1 picked in the model
surface_domain = SurfaceDomain(select_face)
number_slider = DoubleSliderInput(13.98071625, range=0..40)
uv_grid = UVGrid(surface_domain, number_slider, number_slider)
# note: Swap these connections
# For different patterning
delaunay = DelaunayTessellation(uv_grid, select_face)
watch_3d = Watch3D(delaunay)
uv_random = UVRandom(surface_domain, number_slider, number_slider)
# note: Connect these to
# make Revit Stuff
curve_by_points_by_line = CurveByPointsByLine()
