# Dynamo graph Adaptive Component Placement.dyn

select_curve = CurvesBySelection()  # 1 picked in the model
select_curve_2 = CurvesBySelection()  # 1 picked in the model
select_curve_3 = CurvesBySelection()  # 1 picked in the model
list = NewList(index0=select_curve, index1=select_curve_2, index2=select_curve_3)
number_slider = DoubleSliderInput(8.786574688, range=0..20)
xyz_array_on_curve = XYZArrayAlongCurve(list, number_slider, lacing=Longest)
transpose_lists = Transpose(xyz_array_on_curve)
select_family_type = FamilyTypeSelector(index=8)
adaptive_component_by_points = AdaptiveComponentByPoints(transpose_lists, select_family_type, lacing=Longest)
hermite_spline = HermiteSpline(transpose_lists, lacing=Longest)
watch_3d = Watch3D(hermite_spline)
