# Dynamo graph dsfunctions.dyn (Dynamo 1.0.1.1743)

number = DoubleInput(0)
count = Count(number)
add = number + number
mul = _ * _
cos = Math.Cos(number)
PI = Math.PI()
byCoordinates = Point.ByCoordinates(x=number, y=number, z=number)
X = Point.X(byCoordinates)
