# Dynamo graph testTransposeList_normalInput.dyn (Dynamo 1.0.1.1743)

string = StringInput("AB")
string_2 = StringInput("CD")
create_list = List.Create(string, string_2)
number = DoubleInput(21..24)
number_2 = DoubleInput(31..33)
create_list_2 = List.Create(create_list, number, number_2)
transpose = List.Transpose(create_list_2)
watch = Watch(transpose)
watch_2 = Watch(create_list_2)
