# Dynamo graph TestNumberToString_normal.dyn

number = DoubleInput(123456789)
number_to_string = Num2String(number, lacing=Longest)
watch = Watch(number_to_string)
number_2 = DoubleInput(-123456789)
number_to_string_2 = Num2String(number_2, lacing=Longest)
watch_2 = Watch(number_to_string_2)
number_3 = DoubleInput(3.456)
number_to_string_3 = Num2String(number_3, lacing=Longest)
watch_3 = Watch(number_to_string_3)
number_4 = DoubleInput(-3.456)
number_to_string_4 = Num2String(number_4, lacing=Longest)
watch_4 = Watch(number_to_string_4)
