# Dynamo graph ASM_points.dyn (Dynamo 0.6.0)

code_block = CodeBlock { 0..5; }
number = DoubleInput(0)
byCoordinates = Point.ByCoordinates(code_block, number, number)
watch_3d = Watch3D(byCoordinates)
